# Grasshopper definition visual_debugger.gh (Grasshopper 1.0.8)

shapefile_path = Panel("..\input_data\AL_D194_11680_20250123.shp")
save_path = Panel("..\output_data\")
시경계 = Geometry(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)
block_eval = Python3Script(script=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, shapefile_path=shapefile_path, save_path=save_path)  # -> flatten(blocks); inputs shapefile_path: String
#   port script: Script to execute
# ---------- block_eval: Python ----------
# r: pyshp, geopandas, networkx

import sys, pathlib

def ensure_project_paths(shapefile_path_var=None):
    """
    1) 현재 GH 문서(.gh) 파일이 있는 폴더
    2) 그 폴더 하위의 흔한 소스 폴더 후보 (fx, grasshopper, src)
    3) shapefile_path 기반으로 추정한 저장소 루트

    를 순서대로 sys.path에 추가합니다.
    """
    gh_dir = None
    try:
        # ghenv는 GH Python 컴포넌트에서 자동 제공
        gh_doc = ghenv.Component.OnPingDocument()
        gh_path = gh_doc.FilePath  # 절대경로 문자열
        if gh_path:
            gh_dir = pathlib.Path(gh_path).parent
    except Exception:
        pass

    candidates = []

    if gh_dir:
        candidates.append(gh_dir)  # visual_debugger.gh 있는 폴더
        # 하위에 모듈이 따로 있을 수도 있는 구조 대응
        for sub in ("fx", "grasshopper", "src"):
            sub_path = gh_dir / sub
            if sub_path.is_dir():
                candidates.append(sub_path)

    # shapefile_path로부터 루트 추정 (선택적)
    if shapefile_path_var:
        try:
            p = pathlib.Path(str(shapefile_path_var).strip())
            if p.exists():
                # DATA/..../ file 구조라면 부모 두 단계 정도가 루트일 가능성이 큼
                for parent in p.parents[:3]:
                    if (parent / "shape_manager.py").exists():
                        candidates.append(parent)
                        break
        except Exception:
            pass

    # 중복 제거 + sys.path 등록
    added = []
    for c in candidates:
        try:
            c_resolved = str(c.resolve())
            if c_resolved not in sys.path:
                sys.path.insert(0, c_resolved)
                added.append(c_resolved)
        except Exception:
            continue

    if added:
        print("[DEBUG] added to sys.path:", added)

# GH 입력으로 들어온 shapefile_path 변수가 있다면 전달
ensure_project_paths(shapefile_path)

# 이후에야 import (경로 확보 후)
import importlib
import shape_manager, block_generator
from shape_manager import ShapefileManager
from block_generator import BlockGenerator

# (필요 시) 새로고침
# importlib.reload(shape_manager)
# importlib.reload(block_generator)

shapefile_manager = ShapefileManager()
parcels = shapefile_manager.get_parcels_from_shapes(str(shapefile_path))

block_gen = BlockGenerator()
blocks = block_gen.generate(parcels)
print(f"Loaded {len(parcels)} parcels.")
print(f"Generated {len(blocks)} blocks.")
# ---------- end block_eval ----------
py3 = Python3Script(blocks=block_eval)  # -> regions; inputs blocks: list
# ---------- py3: Python ----------
regions = []

for block in blocks:
    regions.append(block.region)
# ---------- end py3 ----------
